# Grasshopper definition Geodesic_Reuse_v2.gh (Grasshopper 1.0.7)
# plug-ins: GhPolyhedra, Kangaroo2 Components, karambaGH

number_of_domes = Slider(2, range=1..10)
pt = Point(Point(0, 0, 0))
pt_2 = Point(Point(1, 0, 0))

# ---- group: Rhino Layers
pipeline = GeometryPipeline(
    GroupByLayer=False,
    GroupByType=False,
    IncludeHidden=True,
    IncludeLocked=True,
    LayerFilter="*rotated roof inner structure",
    NameFilter="*",
    SublayerFiltering=True,
    TypeFilter=1073741848)
pipeline_2 = GeometryPipeline(
    GroupByLayer=False,
    GroupByType=False,
    IncludeHidden=True,
    IncludeLocked=True,
    LayerFilter="*purlins",
    NameFilter="*",
    SublayerFiltering=True,
    TypeFilter=1073741848)
pipeline_3 = GeometryPipeline(
    GroupByLayer=False,
    GroupByType=False,
    IncludeHidden=True,
    IncludeLocked=True,
    LayerFilter="wall studs - external",
    NameFilter="*",
    SublayerFiltering=True,
    TypeFilter=1073741848)
pipeline_4 = GeometryPipeline(
    GroupByLayer=False,
    GroupByType=False,
    IncludeHidden=True,
    IncludeLocked=True,
    LayerFilter="*door frames",
    NameFilter="*",
    SublayerFiltering=True,
    TypeFilter=1073741848)
pipeline_5 = GeometryPipeline(
    GroupByLayer=False,
    GroupByType=False,
    IncludeHidden=True,
    IncludeLocked=True,
    LayerFilter="*roof frame",
    NameFilter="*",
    SublayerFiltering=True,
    TypeFilter=1073741848)
pipeline_6 = GeometryPipeline(
    GroupByLayer=False,
    GroupByType=False,
    IncludeHidden=True,
    IncludeLocked=True,
    LayerFilter="*floor frame",
    NameFilter="*",
    SublayerFiltering=True,
    TypeFilter=1073741848)
pipeline_7 = GeometryPipeline(
    GroupByLayer=False,
    GroupByType=False,
    IncludeHidden=True,
    IncludeLocked=True,
    LayerFilter="*floor joists",
    NameFilter="*",
    SublayerFiltering=True,
    TypeFilter=1073741848)

# ----
brep = Brep([pipeline_2, pipeline])
graft_tree = GraftTree(Tree=brep, IncludeEmptyLists=True, IncludeNullItems=True)
deconstruct_brep = DeconstructBrep(Brep=graft_tree)  # -> Faces, Edges, Vertices
param_viewer = ParamViewer(graft_tree)
evaluate_surface = EvaluateSurface(Surface=reparameterize(deconstruct_brep.Faces), Point="0.5,0.5")  # -> Point, Normal, UDirection, VDirection, Frame
list_item = ListItem(List=brep, Index=Slider(6, range=0..7), Wrap=True)
unit_z = UnitZ(Factor=1)
dot_product = DotProduct(VectorA=unit_z, VectorB=evaluate_surface.Normal, Unitize=False)
equality = Equality(FirstNumber=dot_product, SecondNumber="0")  # -> Equality, Inequality
cull_pattern = CullPattern(List=deconstruct_brep.Faces, CullPattern=equality.Inequality)
is_planar = IsPlanar(Surface=cull_pattern, Interior=True)  # -> Planar, Plane
brep_2 = Brep(cull_pattern)
list_item_2 = ListItem(List=is_planar.Plane, Index=0, Wrap=True)
bounding_box = BoundingBox(Content=graft_tree, Plane=list_item_2)  # -> Box, flatten(Box_2)
deconstruct_box = DeconstructBox(Box=bounding_box.Box)  # -> Plane, flatten(X), flatten(Y), flatten(Z)
number = Number(deconstruct_box.Y)
number_2 = Number(deconstruct_box.X)
number_3 = Number(deconstruct_box.Z)
number_4 = Number(graft(number))
number_5 = Number(graft(number_2))
number_6 = Number(number_3)
panel = Panel(number_6)
panel_2 = Panel(number_5)
panel_3 = Panel(number_4)
larger_than = LargerThan(FirstNumber=panel_2, SecondNumber=panel_3)  # -> LargerThan, OrEqualTo
pick_n_choose = PickNChoose(Pattern=larger_than.LargerThan, Stream0=panel_2, Stream1=panel_3)  # -> flatten(Result)
pick_n_choose_2 = PickNChoose(Pattern=larger_than.LargerThan, Stream0=panel_3, Stream1=panel_2)  # -> flatten(Result)
panel_4 = Panel(pick_n_choose_2)
larger_than_2 = LargerThan(FirstNumber=panel_4, SecondNumber=panel)  # -> LargerThan, OrEqualTo
pick_n_choose_3 = PickNChoose(Pattern=larger_than_2.LargerThan, Stream0=panel, Stream1=panel_4)  # -> flatten(Result)
pick_n_choose_4 = PickNChoose(Pattern=larger_than_2.LargerThan, Stream0=panel_4, Stream1=panel)  # -> flatten(Result)
panel_5 = Panel(pick_n_choose_4)
panel_6 = Panel(pick_n_choose_3)
panel_7 = Panel(pick_n_choose)
larger_than_3 = LargerThan(FirstNumber=panel_7, SecondNumber=panel_5)  # -> LargerThan, OrEqualTo
pick_n_choose_5 = PickNChoose(Pattern=larger_than_3.LargerThan, Stream0=panel_5, Stream1=panel_7)
pick_n_choose_6 = PickNChoose(Pattern=larger_than_3.LargerThan, Stream0=panel_7, Stream1=panel_5)
panel_8 = Panel(pick_n_choose_3)
panel_9 = Panel(pick_n_choose_5)
panel_10 = Panel(pick_n_choose_6)
number_7 = Number(panel_8)
number_8 = Number(panel_9)
number_9 = Number(panel_10)
division = Division(A=number_8, B=number_9)
domain_box = DomainBox(Base=PlaneXY(0, 0, 0), X=number_9, Y=number_9, Z=number_7)
expression = Expression(x=division, Expression="floor(x)")
list_item_3 = ListItem(List=domain_box, Index=Slider(0, range=0..3), Wrap=True)
panel_11 = Panel(expression)
list_length = ListLength(List=panel_11)
series = Series(Start=0, Step=Slider(1, range=0..1), Count=list_length)
unit_x = UnitX(Factor=series)
brep_3 = Brep(domain_box)
move = Move(Geometry=brep_3, Motion=unit_x)  # -> Geometry, Transform
unit_y = UnitY(Factor=Slider(0.3, range=0..1))
linear_array = LinearArray(Geometry=move.Geometry, Direction=unit_y, Count=panel_11)  # -> Geometry, Transform
deconstruct_box_2 = DeconstructBox(Box=linear_array.Geometry)  # -> Plane, X, Y, Z
number_10 = Number(flatten(deconstruct_box_2.Y))
number_11 = Number(flatten(deconstruct_box_2.Z))
number_12 = Number(flatten(deconstruct_box_2.X))
panel_12 = Panel(number_11)
panel_13 = Panel(number_12)
panel_14 = Panel(number_10)

ln = Line(StartPoint=pt, EndPoint=pt_2)

# ---- group: Scaling parameterized curve
number_slider = Slider(0.17, range=0..1)
number_slider_2 = Slider(0.77, range=0..1)
number_slider_3 = Slider(0.07, range=0..1)
number_slider_4 = Slider(0.39, range=0..1)

# ---- group: Subdivision parameterized curve
number_slider_5 = Slider(0.62, range=0..1)
number_slider_6 = Slider(0, range=0..1)
number_slider_7 = Slider(0, range=0..1)
number_slider_8 = Slider(0, range=0..1)

# ---- group: Scaling parameterized curve / Bounds of scale [m]
dom = ConstructDomain(DomainStart="1", DomainEnd="6")

# ---- group: Scaling parameterized curve
merge = Merge(Data1=number_slider, Data2=number_slider_2, Data3=number_slider_3, Data4=number_slider_4)
lng = ListLength(List=merge)
subtraction = Subtraction(A=lng, B=1)
addition = Addition(A=number_of_domes, B=1)
divide = DivideCurve(Curve=ln, Count=subtraction, Kinks=False)  # -> Points, Tangents, Parameters
Z = UnitZ(Factor=merge)
divide_2 = DivideCurve(Curve=ln, Count=addition, Kinks=False)  # -> Points, Tangents, Parameters
dom_2 = ConstructDomain(DomainStart="1", DomainEnd=number_of_domes)
move_2 = Move(Geometry=divide.Points, Motion=Z)  # -> Geometry, Transform
subset = SubList(List=divide_2.Points, Domain=dom_2, Wrap=True)  # -> List, Index
subtraction_2 = Subtraction(A=lng, B=1)
sort_pt = SortPoints(Points=move_2.Geometry)  # -> Points, Indices
Z_2 = UnitZ(Factor=1)
nurbs = NurbsCurve(Vertices=sort_pt.Points, Degree=subtraction_2, Periodic=False)  # -> Curve, Length, Domain
project = ProjectPoint(Point=subset.List, Direction=Z_2, Geometry=nurbs.Curve)  # -> Point, Index
pdecon = Deconstruct(Point=project.Point)  # -> XComponent, YComponent, ZComponent
remap = RemapNumbers(Value=pdecon.ZComponent, Source=Domain(0, 1), Target=dom)  # -> Mapped, Clipped

# ---- group: Subdivision parameterized curve / Bounds of subdivision [integer]
dom_3 = ConstructDomain(DomainStart="1", DomainEnd="3")

# ---- group: Subdivision parameterized curve
merge_2 = Merge(Data1=number_slider_6, Data2=number_slider_7, Data3=number_slider_8, Data4=number_slider_5)
lng_2 = ListLength(List=merge_2)
subtraction_3 = Subtraction(A=lng_2, B=1)
addition_2 = Addition(A=number_of_domes, B=1)
divide_3 = DivideCurve(Curve=ln, Count=subtraction_3, Kinks=False)  # -> Points, Tangents, Parameters
Z_3 = UnitZ(Factor=merge_2)
divide_4 = DivideCurve(Curve=ln, Count=addition_2, Kinks=False)  # -> Points, Tangents, Parameters
dom_4 = ConstructDomain(DomainStart="1", DomainEnd=number_of_domes)
move_3 = Move(Geometry=divide_3.Points, Motion=Z_3)  # -> Geometry, Transform
subset_2 = SubList(List=divide_4.Points, Domain=dom_4, Wrap=True)  # -> List, Index
subtraction_4 = Subtraction(A=lng_2, B=1)
sort_pt_2 = SortPoints(Points=move_3.Geometry)  # -> Points, Indices
Z_4 = UnitZ(Factor=1)
nurbs_2 = NurbsCurve(Vertices=sort_pt_2.Points, Degree=subtraction_4, Periodic=False)  # -> Curve, Length, Domain
project_2 = ProjectPoint(Point=subset_2.List, Direction=Z_4, Geometry=nurbs_2.Curve)  # -> Point, Index
pdecon_2 = Deconstruct(Point=project_2.Point)  # -> XComponent, YComponent, ZComponent
remap_2 = RemapNumbers(Value=pdecon_2.ZComponent, Source=Domain(0, 1), Target=dom_3)  # -> Mapped, Clipped
round = Round(Number=remap_2.Mapped)  # -> Nearest, Floor, Ceiling

# ---- group: Scaling parameterized curve / Scale values
num = Number(remap.Mapped)

# ---- group: Subdivision parameterized curve / Subdivision values
num_2 = Number(round.Nearest)

# ---- group: Array domes in a line
int = Integer(number_of_domes)
multiplication = Multiplication(A=num, B="2")
gap = Panel("1")
addition_3 = Addition(A=multiplication, B=gap)
item = ListItem(List=addition_3, Index=0, Wrap=True)
ma = MassAddition(Input=addition_3)  # -> Result, PartialResults
subtraction_5 = Subtraction(A=ma.PartialResults, B=item)
X = UnitX(Factor=subtraction_5)

# ----
icosphere = IcoSphere(Plane=PlaneXY(0, 0, 0), Scale=num, Density=num_2)  # -> flatten(Mesh)
move_4 = Move(Geometry=icosphere, Motion=X)  # -> Geometry, Transform
mesh = Mesh(simplify(graft(move_4.Geometry)))

# ---- group: orient dome using a 5-valence vertex and normal / vertex 0 seems always to be 5-valence...
vn = VertexNeighbours(Mesh=mesh, VertexNumber="0")  # -> Vertex, simplify(Neighbours), Normal

# ---- group: orient dome using a 5-valence vertex and normal
volume = Volume(Geometry=mesh)  # -> Volume, Centroid
pl = PlaneNormal(Origin=vn.Vertex, ZAxis=vn.Normal)
xy = XYPlane(Origin=volume.Centroid)
orient = Orient(Geometry=mesh, Source=pl, Target=xy)  # -> Geometry, Transform

# ---- group: move to origin
volume_2 = Volume(Geometry=orient.Geometry)  # -> Volume, Centroid
vec2pt = Vector2Pt(PointA=volume_2.Centroid, PointB=volume.Centroid, Unitize=False)  # -> Vector, Length
move_5 = Move(Geometry=orient.Geometry, Motion=vec2pt.Vector)  # -> Geometry, Transform

# ----
pt_3 = ConstructPoint(XCoordinate=Slider(25.44, range=0..100), YCoordinate=Slider(25.44, range=0..100), ZCoordinate=0)
move_6 = Move(Geometry=move_5.Geometry, Motion=pt_3)  # -> Geometry, Transform

# ----
# Geodesic Dome
faceb = FaceBoundaries(Mesh=move_6.Geometry)
boundary = BoundarySurfaces(Edges=faceb)
join = BrepJoin(Breps=boundary)  # -> Breps, Closed
box = Box(join.Breps)
debrep = DeconstructBrep(Brep=box)  # -> Faces, Edges, Vertices
item_2 = ListItem(List=reverse(debrep.Edges), Index=0, Wrap=True)
item_3 = ListItem(List=reverse(debrep.Faces), Index=0, Wrap=True)
len = Length(Curve=item_2)
division_2 = Division(A=len, B=2)
Z_5 = UnitZ(Factor=division_2)
neg = Negative(Value=Z_5)
move_7 = Move(Geometry=item_3, Motion=neg)  # -> Geometry, Transform
split = SplitBrep(Brep=join.Breps, Cutter=move_7.Geometry)
item_4 = ListItem(List=split, Index=0, Wrap=True)
mesh_2 = MeshBrep(
    Brep=item_4,
    Settings={GridMaxCount=0, GridMinCount=16, JaggedSeams=False, MaxEdgeLength=0, MinEdgeLength=0.0001, MinTolerance=0, Refine=True, RefineAngle=0, RelativeTolerance=0.65, SimplePlanes=True, Tolerance=0})
medges = MeshEdges(Mesh=mesh_2)  # -> NakedEdges, InteriorEdges, NonManifoldEdges
crv = Curve([medges.InteriorEdges, medges.NakedEdges])
len_2 = Length(Curve=crv)

X_2 = UnitX(Factor=Slider(10, range=0..10))
mesh_3 = Mesh(mesh_2)
demesh = DeconstructMesh(Mesh=mesh_3)  # -> Vertices, Faces, Colours, Normals

number_slider_9 = Slider(100, range=0..100)
multiplication_2 = Multiplication(A=len_2, B=number_slider_9)
int_2 = Integer(multiplication_2)
division_3 = Division(A=int_2, B=number_slider_9)
cset = CreateSet(List=division_3)  # -> Set, Map
panel_15 = Panel(cset.Set)
mindex = MemberIndex(Set=division_3, Member=cset.Set)  # -> Index, Count
panel_16 = Panel(mindex.Count)

bnd = Bounds(Numbers=len_2)
dedomain = DeconstructDomain(Domain=bnd)  # -> Start, End
gradient = Gradient(
    LowerLimit=dedomain.Start,
    UpperLimit=dedomain.End,
    Parameter=len_2,
    stops=[0: RGB(234, 38, 0), 0.25: RGB(234, 126, 0), 0.5: RGB(254, 244, 84), 0.75: RGB(173, 203, 249), 1: RGB(75, 107, 169)])
pipe = Pipe(Curve=crv, Radius=Slider(0.1, range=0.1..0.5), Caps=0)  # -> flatten(Pipe)
preview = CustomPreview(Geometry=pipe, Material=gradient)

arrlinear = LinearArray(Geometry=medges.InteriorEdges, Direction=X_2, Count=Slider(1, range=0..10))  # -> Geometry, Transform
crv_2 = Curve(flatten(arrlinear.Geometry))

# ---- group: design curves
crv_3 = Curve(crv_2)

# ---- group: Lengths in design
len_3 = Length(Curve=crv_3)

# ----
midpt = CurveMiddle(Curve=crv)
tag = TextTag(Location=midpt, Text=division_3, Colour=ColourSwatch(SwatchColor=RGB(0, 0, 0)))

crv_4 = Curve(crv_3)
end = EndPoints(Curve=crv_4)  # -> Start, End
rdpoints = RemoveDuplicatePointsKaramba3D(Point=[end.Start, end.End], LimitDistance=0.005)  # -> OutPoint, Info, Indexes
pdecon_3 = Deconstruct(Point=rdpoints.OutPoint)  # -> XComponent, YComponent, ZComponent
sort = SortList(Keys=pdecon_3.ZComponent)  # -> Keys, ValuesA
item_5 = ListItem(List=sort.Keys, Index=0, Wrap=True)
num_3 = Number("0.00001")
expression_2 = Expression(zmin=item_5, z=pdecon_3.ZComponent, tol=num_3, Expression="if(abs(zmin-z)<tol,true,false)")
mesh_4 = Mesh(mesh_2)
faceb_2 = FaceBoundaries(Mesh=mesh_4)
boundary_2 = BoundarySurfaces(Edges=flatten(faceb_2))
cull = CullPattern(List=rdpoints.OutPoint, CullPattern=expression_2)
mesh_breps = MeshBrepsKaramba3D(
    Brep=boundary_2,
    MeshResolution="0.1",
    EdgeRefinementFactor=0.67,
    PointReduction=False,
    SmoothingStepSize=0,
    SmoothingIterations=5)  # -> Mesh, Info
Z_6 = UnitZ(Factor="5")  # -> expr("-x", UnitVector)
supp = SupportKaramba3D(PosInd=cull, menu=[buttons(on, on, on, off, off, off)])
linetobeam = LineToBeamKaramba3D(Line=crv_4, New=True, Remove=True, LimitDistance_m=0.005, Bending=Toggle(False))  # -> Element, Points, Info
cross_section = CrossSectionKaramba3D(
    FamilyNameOfCrossSection="DefaultCroSec",
    Material=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,
    Height_cm="5",
    UpperFlangeWidth_cm="5",
    LowerFlangeWidth_cm="5",
    mode="Trapezoid")
loads = LoadsKaramba3D(Vector=Z_6, Mesh=mesh_breps.Mesh, LCase=0, mode="MeshLoad -Const.", menu=[buttons(off, on, off), buttons(off, on)])
matselect = MaterialSelectionKaramba3D(menu=[dropdown(4), dropdown(1)])
assemble = AssembleModelKaramba3D(Elem=linetobeam.Element, Support=supp, Load=loads, CrossSection=cross_section, Material=matselect, LimitDistance_m=0.005)  # -> Model, Info, Mass_kg, CenterOfGravity
analyze = AnalyzeKaramba3D(Model=assemble.Model)  # -> CalculatedModel, MaximumDisplacement_cm, ResultingForceOfGravity_kN, ElasticEnergy_kNm
disassemble = DisassembleMaterialKaramba3D(Material=matselect)  # -> Material, TypeOfMaterial, FamilyNameOfMaterial, NameOfMaterial, ElemIdentifiers, Color, YoungsModulusKNCm2Dir12, InPlaneShearModulus_kN_cm2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
modelview = ModelViewKaramba3D(Model=analyze.CalculatedModel, ResultFactors=1, ResultCase=-1)  # -> Model, DeformedMesh, DeformedAxes, DeformedModel
beamview = BeamViewKaramba3D(Model=modelview.Model)  # -> Model, MeshesOfRenderedBeams, DeformedBeamAxes, LegendColors, LegendTags
b_forces = BeamForcesKaramba3D(AnalyzedModel=beamview.Model, LCase=-1, MaximumDistanceBetweenResults_m=-1, NumberOfResultsPerBeamElement=2)  # -> AnalyzedModel, NormalForce_kN, ShearForceVz_kN, ShearForceVy_kN, BendingMomentMt_kNm, BendingMomentMy_kNm, BendingMomentMz_kNm
item_6 = ListItem(List=b_forces.NormalForce_kN, Index=0, Wrap=True)  # -> flatten(Item)
legend = Legend(Colour=beamview.LegendColors, Tags=beamview.LegendTags, LegendType=1)

# ---- group: Allowable stress [kN/cm^2], assumed 0.5*yield stress
num_4 = Number(disassemble.YieldStrengthKNCm2Dir12)
multiplication_3 = Multiplication(A=num_4, B="0.5")

# ---- group: Elastic modulus [kN/cm^2]
num_5 = Number(disassemble.YoungsModulusKNCm2Dir12)

# ----
target_load_demand_kn = Number(item_6)

# ---- group: X = Demand
pt_4 = ConstructPoint(XCoordinate=target_load_demand_kn, YCoordinate=0, ZCoordinate=len_3)

# ---- group: Matching and visualization / design curves
crv_5 = Curve(crv_3)

# ---- group: Visualization parameters
swatch = ColourSwatch(SwatchColor=RGB(191, 191, 191))
swatch_2 = ColourSwatch(SwatchColor=RGB(0, 0, 0))
swatch_3 = ColourSwatch(SwatchColor=RGB(125, 125, 125))
swatch_4 = ColourSwatch(SwatchColor=RGB(242, 17, 96))
swatch_5 = ColourSwatch(SwatchColor=RGB(29, 190, 222))
swatch_6 = ColourSwatch(SwatchColor=RGBA(255, 255, 255, 0))
swatch_7 = ColourSwatch(SwatchColor=RGB(58, 29, 222))
swatch_8 = ColourSwatch(SwatchColor=RGB(184, 148, 20))
col = Colour(RGB(191, 191, 191))
col_2 = Colour(RGB(0, 0, 0))
col_3 = Colour(RGB(184, 148, 20))
col_4 = Colour(RGB(125, 125, 125))
col_5 = Colour(RGB(242, 17, 96))
col_6 = Colour(RGB(29, 190, 222))
col_7 = Colour(RGBA(255, 255, 255, 0))
col_8 = Colour(RGB(58, 29, 222))

# ----
preview_2 = CustomPreview(Geometry=crv_3, Material=col_2)

lng_3 = ListLength(List=panel_12)
panel_17 = Panel(lng_3)
Z_7 = UnitZ(Factor=1)
pt_5 = ConstructPoint(XCoordinate=0, YCoordinate=0, ZCoordinate=0)
series_2 = Series(Start=0, Step=Slider(1, range=0..1), Count=panel_17)
X_3 = UnitX(Factor=series_2)
line = LineSDL(Start=pt_5, Direction=Z_7, Length=panel_12)
Y = UnitY(Factor=panel_14)
X_4 = UnitX(Factor=panel_13)

sort_2 = SortList(Keys=panel_12, ValuesA=line)  # -> Keys, ValuesA
line_2 = Line(sort_2.ValuesA)

move_8 = Move(Geometry=sort_2.ValuesA, Motion=X_3)  # -> Geometry, Transform
extr = Extrude(Base=move_8.Geometry, Direction=X_4)
extr_2 = Extrude(Base=extr, Direction=Y)

vlen = VectorLength(Vector=X_4)
vlen_2 = VectorLength(Vector=Y)
min = Minimum(A=vlen, B=vlen_2)
max = Maximum(A=vlen, B=vlen_2)

# ---- group: inventory curves
crv_6 = Curve(move_8.Geometry)

# ---- group: Moment of inertia [m^4]
expression_3 = Expression(b=max, h=min, Expression="b*h^3/12")

# ---- group: Cross sectional area [m^2]
multiplication_4 = Multiplication(A=vlen, B=vlen_2)

# ----
len_4 = Length(Curve=move_8.Geometry)

# ---- group: Lengths in inventory
len_5 = Length(Curve=crv_6)

# ---- group: convert to cm^2
multiplication_5 = Multiplication(A=multiplication_4, B="10000")

# ---- group: Convert to cm
multiplication_6 = Multiplication(A=len_4, B="100")

# ---- group: Convert to cm^4
multiplication_7 = Multiplication(A=expression_3, B="100000000")

# ---- group: Buckling capacity [kN]
expression_4 = Expression(E=num_5, I=multiplication_7, L=multiplication_6, Expression="(1/3)*Pi^2*E*I/(L^2)")

# ---- group: Strength capacity [kN]
multiplication_8 = Multiplication(A=multiplication_5, B=multiplication_3)

# ---- group: Compressive capacity [kN]
min_2 = Minimum(A=multiplication_8, B=expression_4)

# ---- group: Tensile capacity [kN]
num_6 = Number(multiplication_8)

# ---- group: X = Tensile capacity, Y = Compressive capacity
pt_6 = ConstructPoint(XCoordinate=num_6, YCoordinate=min_2, ZCoordinate=len_5)

# ---- group: Matching setup
# If capacity is insufficient or
# length is too short, add big penalty.
# If demand > 0,
# use tensile capacity.
crossref = CrossReference(ListA=simplify(graft(pt_4)), ListB=pt_6, CrossMode=1)  # -> ListA, ListB
pdecon_4 = Deconstruct(Point=crossref.ListA)  # -> XComponent, YComponent, ZComponent
pdecon_5 = Deconstruct(Point=crossref.ListB)  # -> XComponent, YComponent, ZComponent
pdecon_6 = Deconstruct(Point=crossref.ListA)  # -> XComponent, YComponent, ZComponent
pdecon_7 = Deconstruct(Point=crossref.ListB)  # -> XComponent, YComponent, ZComponent
larger = LargerThan(FirstNumber=pdecon_4.XComponent, SecondNumber=0)  # -> LargerThan, OrEqualTo
expression_5 = Expression(cond=larger.LargerThan, a=pdecon_5.XComponent, b=pdecon_5.YComponent, Expression="if(cond,a,b)")
abs = Absolute(Value=pdecon_4.XComponent)
abs_2 = Absolute(Value=expression_5)
smaller = SmallerThan(FirstNumber=pdecon_6.ZComponent, SecondNumber=pdecon_7.ZComponent)  # -> SmallerThan, OrEqualTo
smaller_2 = SmallerThan(FirstNumber=abs, SecondNumber=abs_2)  # -> SmallerThan, OrEqualTo
pt_7 = ConstructPoint(XCoordinate=abs, YCoordinate=0, ZCoordinate=pdecon_6.ZComponent)
pt_8 = ConstructPoint(XCoordinate=abs_2, YCoordinate=0, ZCoordinate=pdecon_7.ZComponent)
panel_18 = Panel("1000000")
or = GateOr(A=smaller.SmallerThan, B=smaller_2.SmallerThan)
dist = Distance(PointA=pt_7, PointB=pt_8)
expression_6 = Expression(okay=or, big=panel_18, dist=dist, Expression="if(okay, dist, big)")
num_7 = Number(simplify(expression_6))

# ----
panel_19 = Panel(pdecon_4.XComponent)
number_13 = Number(panel_18)

# ---- group: Matching and visualization / inventory curves
crv_7 = Curve(crv_6)

# ---- group: Matching and visualization / inventory geometries
geo = Geometry(extr_2)

# ----
panel_20 = Panel(num_7)

volume_3 = Volume(Geometry=move_6.Geometry)  # -> Volume, Centroid

# ---- group: Supports
deplane = DeconstructPlane(Plane=move_7.Geometry)  # -> Origin, XAxis, YAxis, ZAxis
ccx = CurveCurve(CurveA=crv, CurveB=crv)  # -> flatten(Points), ParamsA, ParamsB
cullpt = CullDuplicates(Points=ccx.Points, Tolerance=0.1, CullMode=3)  # -> Points, Indices, Valence
pt_9 = Point(cullpt.Points)
pdecon_8 = Deconstruct(Point=pt_9)  # -> XComponent, YComponent, ZComponent
number_slider_10 = Slider(0.646, range=0..100)
smaller_3 = SmallerThan(FirstNumber=pdecon_8.ZComponent, SecondNumber=number_slider_10)  # -> SmallerThan, OrEqualTo
larger_2 = LargerThan(FirstNumber=pdecon_8.ZComponent, SecondNumber=number_slider_10)  # -> LargerThan, OrEqualTo
cull_2 = CullPattern(List=cullpt.Points, CullPattern=smaller_3.SmallerThan)
cull_3 = CullPattern(List=cullpt.Points, CullPattern=larger_2.LargerThan)

# ----
pt_10 = Point(cull_3)
ln_2 = Line(StartPoint=volume_3.Centroid, EndPoint=pt_10)
vec = Vector(simplify(ln_2))
vec_2 = Vector(expr("0.02*x", vec))
circle = CircleCNR(Center=pt_10, Normal=vec, Radius=Slider(0.1, range=0..1))
extr_3 = Extrude(Base=circle, Direction=vec_2)
vdis = VectorDisplay(Anchor=pt_10, Vector=vec_2)
cap = CapHoles(Brep=extr_3)

# ---- group: Supports / Points in
pt_11 = Point(cull_2)

# ---- group: Supports (continued)
sph = Sphere(Base=pt_11, Radius=Slider(0.1, range=0..1))

# ---- group: Supports / Points out
pt_12 = Point(cull_3)

# ---- group: Matching and visualization
panel_21 = Panel("1e3")
panel_22 = Panel(""".5
.1""")

# ---- group: Matching and visualization / using baked-in implementation
c_script = CSharpScript(distance_matrix=num_7, integral_scale=panel_21, penalty=number_13)  # -> out, matched_A2B_ids, cost_star; inputs distance_matrix: tree of Double, integral_scale: Double, penalty: Double
# ---------- c_script: C# usings ----------
using System.IO;
using System.Linq;
using System.Data;
using System.Drawing;
using System.Reflection;
using System.Windows.Forms;
using System.Xml;
using System.Xml.Linq;
using System.Runtime.InteropServices;

using Rhino.DocObjects;
using Rhino.Collections;
using GH_IO;
using GH_IO.Serialization;
# ---------- c_script: C# ----------
    // dimension of the input lists
    int n = distance_matrix.BranchCount;
    int m = distance_matrix.Branch(0).Count;

    if(0 == m * n)
    {
      this.Component.AddRuntimeMessage(Grasshopper.Kernel.GH_RuntimeMessageLevel.Error, "intput tree data branch dimension = 0!");
      return;
    }

    if(n > m)
    {
      this.Component.AddRuntimeMessage(Grasshopper.Kernel.GH_RuntimeMessageLevel.Error,
        "Branch count must be smaller than the size of each branch! (design pt number should be smaller than inventory pts!)");
      return;
    }
    // The algorithm doesn't always produce the most optimal result, when the input contains more columns (m) than rows (n).
    // To overcome this issue, square the dimensions of the input before passing it to the algorithm.

    //    var watch = new System.Diagnostics.Stopwatch();
    //    if(timing)
    //    {
    //      watch.Start();
    //    }

    // generate the cost matrix
    int[,] costs = new int[m, m];

    for(int i = 0; i < m; i++)
    {
      for(int j = 0; j < m; j++)
      {
        if(i >= n)
        {
          // fill the matrix to be square
          costs[i, j] = (int) Int32.MaxValue;
        }
        else
        {
          // the algorithm only takes integral inputs, scale it up here.
          double scaled_cost = distance_matrix.Branch(i)[j] * integral_scale;
          if(scaled_cost > Int32.MaxValue) {
            throw new OverflowException(
              //            this.Component.AddRuntimeMessage(Grasshopper.Kernel.GH_RuntimeMessageLevel.Error,
              String.Format("Cost at ({0},{1}): {2} bigger than maximal integral value {3}", i, j, scaled_cost, Int32.MaxValue));
          }
          costs[i, j] = (int) scaled_cost;
        }
      }
    }

    int[,] costs_copy = (int[,]) costs.Clone();

    double final_cost = 0;
    int[] matched_pts2_ids = HungarianAlgorithm.FindAssignments(costs);

    DataTree<int> matched_A2B = new DataTree<int>();
    for(int i = 0; i < n; i++)
    {
      var pth = new GH_Path(i);
      final_cost += (double) costs_copy[i, matched_pts2_ids[i]] / integral_scale;
      matched_A2B.Add(matched_pts2_ids[i], pth);
    }

    if(final_cost > penalty)
    {
      this.Component.AddRuntimeMessage(Grasshopper.Kernel.GH_RuntimeMessageLevel.Error,
        "Computed assignment cost > penalty terms!");
      throw new Exception("Infeasible matching.");
    }

    //    if(timing)
    //    {
    //      watch.Stop();
    //      Print(String.Format("Execution Time: {0} ms", watch.ElapsedMilliseconds));
    //    }

    matched_A2B_ids = matched_A2B;
    cost_star = final_cost;
# ---------- c_script: C# additional code ----------
  /// <summary>
  /// Hungarian Algorithm.
  /// </summary>
  public static class HungarianAlgorithm
  {
    /// <summary>
    /// Finds the optimal assignments for a given matrix of agents and costed tasks such that the total cost is minimized.
    /// </summary>
    /// <param name="costs">A cost matrix; the element at row <em>i</em> and column <em>j</em> represents the cost of agent <em>i</em> performing task <em>j</em>.</param>
    /// <returns>A matrix of assignments; the value of element <em>i</em> is the column of the task assigned to agent <em>i</em>.</returns>
    /// <exception cref="ArgumentNullException"><paramref name="costs"/> is null.</exception>
    public static int[] FindAssignments(int[,] costs)
    {
      if (costs == null)
        throw new ArgumentNullException("costs null!");

      var h = costs.GetLength(0);
      var w = costs.GetLength(1);

      for (var i = 0; i < h; i++)
      {
        var min = int.MaxValue;

        for (var j = 0; j < w; j++)
        {
          min = Math.Min(min, costs[i, j]);
        }

        for (var j = 0; j < w; j++)
        {
          costs[i, j] -= min;
        }
      }

      var masks = new byte[h, w];
      var rowsCovered = new bool[h];
      var colsCovered = new bool[w];

      for (var i = 0; i < h; i++)
      {
        for (var j = 0; j < w; j++)
        {
          if (costs[i, j] == 0 && !rowsCovered[i] && !colsCovered[j])
          {
            masks[i, j] = 1;
            rowsCovered[i] = true;
            colsCovered[j] = true;
          }
        }
      }

      ClearCovers(rowsCovered, colsCovered, w, h);

      var path = new Location[w * h];
      var pathStart = default(Location);
      var step = 1;

      while (step != -1)
      {
        switch (step)
        {
          case 1:
            step = HungarianAlgorithm.RunStep1(masks, colsCovered, w, h);
            break;

          case 2:
            step = HungarianAlgorithm.RunStep2(costs, masks, rowsCovered, colsCovered, w, h, ref pathStart);
            break;

          case 3:
            step = HungarianAlgorithm.RunStep3(masks, rowsCovered, colsCovered, w, h, path, pathStart);
            break;

          case 4:
            step = HungarianAlgorithm.RunStep4(costs, rowsCovered, colsCovered, w, h);
            break;
        }
      }

      var agentsTasks = new int[h];

      for (var i = 0; i < h; i++)
      {
        for (var j = 0; j < w; j++)
        {
          if (masks[i, j] == 1)
          {
            agentsTasks[i] = j;
            break;
          }
        }
      }

      return agentsTasks;
    }

    private static int RunStep1(byte[,] masks, bool[] colsCovered, int w, int h)
    {
      if (masks == null)
        throw new ArgumentNullException("null masks!");

      if (colsCovered == null)
        throw new ArgumentNullException("null colsCovered!");

      for (var i = 0; i < h; i++)
      {
        for (var j = 0; j < w; j++)
        {
          if (masks[i, j] == 1)
            colsCovered[j] = true;
        }
      }

      var colsCoveredCount = 0;

      for (var j = 0; j < w; j++)
      {
        if (colsCovered[j])
          colsCoveredCount++;
      }

      if (colsCoveredCount == h)
        return -1;

      return 2;
    }
    private static int RunStep2(int[,] costs, byte[,] masks, bool[] rowsCovered, bool[] colsCovered, int w, int h, ref Location pathStart)
    {
      if (costs == null)
        throw new ArgumentNullException("null costs");

      if (masks == null)
        throw new ArgumentNullException("null masks");

      if (rowsCovered == null)
        throw new ArgumentNullException("null rowsCovered");

      if (colsCovered == null)
        throw new ArgumentNullException("null colsCovered");

      while (true)
      {
        var loc = HungarianAlgorithm.FindZero(costs, rowsCovered, colsCovered, w, h);
        if (loc.row == -1)
          return 4;

        masks[loc.row, loc.column] = 2;

        var starCol = HungarianAlgorithm.FindStarInRow(masks, w, loc.row);
        if (starCol != -1)
        {
          rowsCovered[loc.row] = true;
          colsCovered[starCol] = false;
        }
        else
        {
          pathStart = loc;
          return 3;
        }
      }
    }
    private static int RunStep3(byte[,] masks, bool[] rowsCovered, bool[] colsCovered, int w, int h, Location[] path, Location pathStart)
    {
      if (masks == null)
        throw new ArgumentNullException("null masks");

      if (rowsCovered == null)
        throw new ArgumentNullException("null rowsCovered");

      if (colsCovered == null)
        throw new ArgumentNullException("null colsCovered");

      var pathIndex = 0;
      path[0] = pathStart;

      while (true)
      {
        var row = HungarianAlgorithm.FindStarInColumn(masks, h, path[pathIndex].column);
        if (row == -1)
          break;

        pathIndex++;
        path[pathIndex] = new Location(row, path[pathIndex - 1].column);

        var col = HungarianAlgorithm.FindPrimeInRow(masks, w, path[pathIndex].row);

        pathIndex++;
        path[pathIndex] = new Location(path[pathIndex - 1].row, col);
      }

      HungarianAlgorithm.ConvertPath(masks, path, pathIndex + 1);
      HungarianAlgorithm.ClearCovers(rowsCovered, colsCovered, w, h);
      HungarianAlgorithm.ClearPrimes(masks, w, h);

      return 1;
    }
    private static int RunStep4(int[,] costs, bool[] rowsCovered, bool[] colsCovered, int w, int h)
    {
      if (costs == null)
        throw new ArgumentNullException("null costs");

      if (rowsCovered == null)
        throw new ArgumentNullException("null rowsCovered");

      if (colsCovered == null)
        throw new ArgumentNullException("null colsCovered");

      var minValue = HungarianAlgorithm.FindMinimum(costs, rowsCovered, colsCovered, w, h);

      for (var i = 0; i < h; i++)
      {
        for (var j = 0; j < w; j++)
        {
          if (rowsCovered[i])
            costs[i, j] += minValue;
          if (!colsCovered[j])
            costs[i, j] -= minValue;
        }
      }
      return 2;
    }

    private static int FindMinimum(int[,] costs, bool[] rowsCovered, bool[] colsCovered, int w, int h)
    {
      if (costs == null)
        throw new ArgumentNullException("null costs");

      if (rowsCovered == null)
        throw new ArgumentNullException("null rowsCovered");

      if (colsCovered == null)
        throw new ArgumentNullException("null colsCovered");

      var minValue = int.MaxValue;

      for (var i = 0; i < h; i++)
      {
        for (var j = 0; j < w; j++)
        {
          if (!rowsCovered[i] && !colsCovered[j])
            minValue = Math.Min(minValue, costs[i, j]);
        }
      }

      return minValue;
    }
    private static int FindStarInRow(byte[,] masks, int w, int row)
    {
      if (masks == null)
        throw new ArgumentNullException("null masks");

      for (var j = 0; j < w; j++)
      {
        if (masks[row, j] == 1)
          return j;
      }

      return -1;
    }
    private static int FindStarInColumn(byte[,] masks, int h, int col)
    {
      if (masks == null)
        throw new ArgumentNullException("null masks");

      for (var i = 0; i < h; i++)
      {
        if (masks[i, col] == 1)
          return i;
      }

      return -1;
    }
    private static int FindPrimeInRow(byte[,] masks, int w, int row)
    {
      if (masks == null)
        throw new ArgumentNullException("null masks");

      for (var j = 0; j < w; j++)
      {
        if (masks[row, j] == 2)
          return j;
      }

      return -1;
    }
    private static Location FindZero(int[,] costs, bool[] rowsCovered, bool[] colsCovered, int w, int h)
    {
      if (costs == null)
        throw new ArgumentNullException("null costs");

      if (rowsCovered == null)
        throw new ArgumentNullException("null rowsCovered");

      if (colsCovered == null)
        throw new ArgumentNullException("null colsCovered");

      for (var i = 0; i < h; i++)
      {
        for (var j = 0; j < w; j++)
        {
          if (costs[i, j] == 0 && !rowsCovered[i] && !colsCovered[j])
            return new Location(i, j);
        }
      }

      return new Location(-1, -1);
    }
    private static void ConvertPath(byte[,] masks, Location[] path, int pathLength)
    {
      if (masks == null)
        throw new ArgumentNullException("null masks");

      if (path == null)
        throw new ArgumentNullException("null path");

      for (var i = 0; i < pathLength; i++)
      {
        if (masks[path[i].row, path[i].column] == 1)
        {
          masks[path[i].row, path[i].column] = 0;
        }
        else if (masks[path[i].row, path[i].column] == 2)
        {
          masks[path[i].row, path[i].column] = 1;
        }
      }
    }
    private static void ClearPrimes(byte[,] masks, int w, int h)
    {
      if (masks == null)
        throw new ArgumentNullException("null masks");

      for (var i = 0; i < h; i++)
      {
        for (var j = 0; j < w; j++)
        {
          if (masks[i, j] == 2)
            masks[i, j] = 0;
        }
      }
    }
    private static void ClearCovers(bool[] rowsCovered, bool[] colsCovered, int w, int h)
    {
      if (rowsCovered == null)
        throw new ArgumentNullException("null rowsCovered");

      if (colsCovered == null)
        throw new ArgumentNullException("null colsCovered");

      for (var i = 0; i < h; i++)
      {
        rowsCovered[i] = false;
      }

      for (var j = 0; j < w; j++)
      {
        colsCovered[j] = false;
      }
    }

    private struct Location
    {
      internal readonly int row;
      internal readonly int column;

      internal Location(int row, int col)
      {
        this.row = row;
        this.column = col;
      }
    }
  } // end HungarianAlgorithm class
# ---------- end c_script ----------

# ---- group: Matching and visualization / using external dll
c_script_2 = CSharpScript(
    distance_matrix=num_7,
    integral_scale=panel_21,
    penalty=number_13,
    Reference="C:\Users\harry\Dropbox (MIT)\Projects\CircularEconomy\CDoS_2021\scripts\YJ\HungarianAlgorithm.dll")  # -> out, matched_A2B_ids, cost_star; inputs distance_matrix: tree of Double, integral_scale: Double, penalty: Double
# ---------- c_script_2: C# usings ----------
using System.IO;
using System.Linq;
using System.Data;
using System.Drawing;
using System.Reflection;
using System.Windows.Forms;
using System.Xml;
using System.Xml.Linq;
using System.Runtime.InteropServices;

using Rhino.DocObjects;
using Rhino.Collections;
using GH_IO;
using GH_IO.Serialization;

using HungarianAlgorithm;
using HungarianAlgorithm.Extensions;
# ---------- c_script_2: C# ----------
    // dimension of the input lists
    int n = distance_matrix.BranchCount;
    int m = distance_matrix.Branch(0).Count;

    if(0 == m * n)
    {
      this.Component.AddRuntimeMessage(Grasshopper.Kernel.GH_RuntimeMessageLevel.Error, "intput tree data branch dimension = 0!");
      return;
    }

    if(n > m)
    {
      this.Component.AddRuntimeMessage(Grasshopper.Kernel.GH_RuntimeMessageLevel.Error,
        "Branch count must be smaller than the size of each branch! (design pt number should be smaller than inventory pts!)");
      return;
    }
    // The algorithm doesn't always produce the most optimal result, when the input contains more columns (m) than rows (n).
    // To overcome this issue, square the dimensions of the input before passing it to the algorithm.

    //    var watch = new System.Diagnostics.Stopwatch();
    //    if(timing)
    //    {
    //      watch.Start();
    //    }

    // generate the cost matrix
    int[,] costs = new int[m, m];

    for(int i = 0; i < m; i++)
    {
      for(int j = 0; j < m; j++)
      {
        if(i >= n)
        {
          // fill the matrix to be square
          costs[i, j] = (int) Int32.MaxValue;
        }
        else
        {
          // the algorithm only takes integral inputs, scale it up here.
          double scaled_cost = distance_matrix.Branch(i)[j] * integral_scale;
          if(scaled_cost > Int32.MaxValue) {
            throw new OverflowException(
              //            this.Component.AddRuntimeMessage(Grasshopper.Kernel.GH_RuntimeMessageLevel.Error,
              String.Format("Cost at ({0},{1}): {2} bigger than maximal integral value {3}", i, j, scaled_cost, Int32.MaxValue));
          }
          costs[i, j] = (int) scaled_cost;
        }
      }
    }

    int[,] costs_copy = (int[,]) costs.Clone();

    double final_cost = 0;
    int[] matched_pts2_ids = HungarianAlgorithm.HungarianAlgorithm.FindAssignments(costs);

    DataTree<int> matched_A2B = new DataTree<int>();
    for(int i = 0; i < n; i++)
    {
      var pth = new GH_Path(i);
      final_cost += (double) costs_copy[i, matched_pts2_ids[i]] / integral_scale;
      matched_A2B.Add(matched_pts2_ids[i], pth);
    }

    if(final_cost > penalty)
    {
      this.Component.AddRuntimeMessage(Grasshopper.Kernel.GH_RuntimeMessageLevel.Error,
        "Computed assignment cost > penalty terms!");
      throw new Exception("Infeasible matching.");
    }

    //    if(timing)
    //    {
    //      watch.Stop();
    //      Print(String.Format("Execution Time: {0} ms", watch.ElapsedMilliseconds));
    //    }

    matched_A2B_ids = matched_A2B;
    cost_star = final_cost;
# ---------- end c_script_2 ----------

# ---- group: Matching and visualization / A index -> B index
int_3 = Integer(c_script_2.matched_A2B_ids)

# ---- group: Matching and visualization / visualize with matching lines
pframe = PerpFrame(Curve=reparameterize(crv_5), Parameter="0.5")
pframe_2 = PerpFrame(Curve=reparameterize(crv_7), Parameter="0.5")
item_7 = ListItem(List=pframe_2, Index=flatten(int_3), Wrap=True)
ln_3 = Line(StartPoint=pframe, EndPoint=item_7)

# ---- group: Matching and visualization (continued)
item_8 = ListItem(List=crv_7, Index=flatten(int_3), Wrap=True)
item_9 = ListItem(List=geo, Index=flatten(int_3), Wrap=True)
orient_2 = Orient(Geometry=item_9, Source=item_7, Target=pframe)  # -> Geometry, Transform
preview_3 = CustomPreview(Geometry=orient_2.Geometry, Material=col_3)
dash = DashPattern(Curve=ln_3, Pattern=panel_22)  # -> Dashes, Gaps
preview_4 = CustomPreview(
    Geometry=dash.Dashes,
    Material={diffuse=RGB(221, 160, 221), emission=RGB(66, 48, 66), shine=0.5, specular=RGB(255, 255, 255), transparency=0})

# ---- group: Matching and visualization / compute total matching cost
item_10 = ListItem(List=num_7, Index=int_3, Wrap=True)
ma_2 = MassAddition(Input=flatten(item_10))  # -> Result, PartialResults

# ----
panel_23 = Panel(item_10)
panel_24 = Panel(ma_2.Result)
